test file "DriverRequest_REQ_Based_Test"
  coverage: Decision, MCDC, SignalRange, SimulinkDesignVerifier, RelationalBoundary, Condition, LookupTable, SaturationOnIntOverflow

suite "REQ-Based Test"

  case "Enable button" [simulation]
    description: Simulation test for FCN01 and FCN02.
    model DriverRequest, harness DriverRequest_Harness_REQ
    signal scenario: Enable (test1_Harness_REQ/Harness Inputs)
    custom criteria:
      yout = sltest_simout.get('yout');
      compOut = yout.get(1).Values.Data;
      test.verifyTrue(all(compOut));

  case "Cancel button" [simulation]
    description: Simulation test for FCN04.
    model DriverRequest, harness DriverRequest_Harness_REQ
    signal scenario: Cancel (test1_Harness_REQ/Harness Inputs)
    custom criteria: same code as in custom criteria of case "Enable button"

  case "Set button" [simulation]
    description: Simulation test for FCN03.
    model DriverRequest, harness DriverRequest_Harness_REQ
    signal scenario: Set (test1_Harness_REQ/Harness Inputs)
    custom criteria: same code as in custom criteria of case "Enable button"

  case "Resume button" [simulation]
    description: Simulation test for FCN10.
    model DriverRequest, harness DriverRequest_Harness_REQ
    signal scenario: Resume (test1_Harness_REQ/Harness Inputs)
    custom criteria: same code as in custom criteria of case "Enable button"

  case "Increment button short" [simulation]
    description: Simulation test for FCN05.
    model DriverRequest, harness DriverRequest_Harness_REQ
    signal scenario: ShortInc (test1_Harness_REQ/Harness Inputs)
    custom criteria: same code as in custom criteria of case "Enable button"

  case "Increment button hold" [simulation]
    description: Simulation test for FCN07.
    model DriverRequest, harness DriverRequest_Harness_REQ
    signal scenario: LongInc (test1_Harness_REQ/Harness Inputs)
    custom criteria: same code as in custom criteria of case "Enable button"

  case "Decrement button short" [simulation]
    description: Simulation test for FCN06.
    model DriverRequest, harness DriverRequest_Harness_REQ
    signal scenario: ShortDec (test1_Harness_REQ/Harness Inputs)
    custom criteria: same code as in custom criteria of case "Enable button"

  case "Decrement button hold" [simulation]
    description: Simulation test for FCN08.
    model DriverRequest, harness DriverRequest_Harness_REQ
    signal scenario: LongDec (test1_Harness_REQ/Harness Inputs)
    custom criteria: same code as in custom criteria of case "Enable button"